# Grasshopper definition Shadow area portion_CWM.gh (Grasshopper 1.0.7)
# plug-ins: HDTTreeUtils, CORE.Toolbox.Grasshopper

panel = Panel("C:\UCBcourses\RESEARCH\Lau grant\solar\validation\GH 3D model\")
path = FilePath("C:\UCBcourses\RESEARCH\Lau grant\solar\validation\GH_building.csv")
join = TextJoin(Text=[panel, "1-1", "_ORNL563_forGH.csv"])
path_2 = FilePath(join)
number_slider = Slider(100, range=0..100)
python = GhPythonScript(x=path_2)  # -> out, heights, polylines
# ---------- python: Python ----------
__author__ = "vapeu"
__version__ = "2024.07.04"

import rhinoscriptsyntax as rs
import Rhino.Geometry as rg
import csv
from ghpythonlib.treehelpers import list_to_tree

# File path to the CSV file
file_path = x

heights = []
polylines = []

with open(file_path, 'r') as csvfile:
    reader = csv.DictReader(csvfile)
    for row in reader:
        height = float(row['Height'])
        heights.append(height)
        
        points_str = row['coordinates'][1:-1]  # Remove the square brackets
        points = []
        for pt_str in points_str.split('), ('):  # Split by '), ('
            pt_str = pt_str.strip('()')  # Remove any remaining parentheses
            y,x = map(float, pt_str.split(', '))
            points.append(rg.Point3d(y, x, 0))
        
        polyline = rg.Polyline(points)
        polylines.append(polyline)

# Output to Grasshopper
heights = list_to_tree(heights)
polylines = list_to_tree(polylines)
# ---------- end python ----------
number_slider_2 = Slider(130, range=0..1000)
num = Number(simplify(graft(python.heights)))
pline = PolyLine(Vertices=python.polylines, Closed=True)  # -> simplify(Polyline)
Z = UnitZ(Factor=num)
srf = Surface(pline)
area = Area(Geometry=srf)  # -> Area, Centroid
item = ListItem(List=flatten(area.Centroid), Index=0, Wrap=True)
number_slider_3 = Slider(1, range=0..10)
neg = Negative(Value=item)
move = Move(Geometry=srf, Motion=neg)  # -> Geometry, Transform
extr = Extrude(Base=move.Geometry, Direction=Z)
cap = CapHoles(Brep=extr)
panel_2 = Panel("0.91768213 -0.28776005 -0.27395922")
number_slider_4 = Slider(7, range=0..7)
number_slider_5 = Slider(0, range=0..100)
number_slider_6 = Slider(4, range=0..13)
item_2 = ListItem(List=flatten(cap), Index=number_slider_6, Wrap=True)
debrep = DeconstructBrep(Brep=item_2)  # -> Faces, Edges, Vertices
area_2 = Area(Geometry=debrep.Faces)  # -> Area, Centroid
devec = DeconstructVector(Vector=area_2.Centroid)  # -> XComponent, YComponent, ZComponent
sort = SortList(Keys=devec.ZComponent, ValuesA=debrep.Faces)  # -> Keys, ValuesA
python_2 = GhPythonScript(surfaces_list=sort.ValuesA)  # -> out, roof, facades; inputs surfaces_list: list of Brep
# ---------- python_2: Python ----------
__author__ = "vapeu"
__version__ = "2024.08.06"

import rhinoscriptsyntax as rs

roof = surfaces_list[-1]
facades = surfaces_list[1:-1]
# ---------- end python_2 ----------
pt = ConstructPoint(XCoordinate=0, YCoordinate=0, ZCoordinate=0)
shading_component = Brep(cap)

# ----
# ROOF
srf_2 = Surface(python_2.roof)

# ----
# FACADES
srf_3 = Surface(python_2.facades)

item_3 = ListItem(List=srf_3, Index=number_slider_6, Wrap=True)
area_3 = Area(Geometry=item_3)  # -> Area, Centroid
panel_3 = Panel(area_3.Area)

number_slider_7 = Slider(18, range=0..23)
run = BooleanToggle(False)
python_3 = PythonScript(Run=run, Target=Slider(23, range=1..1000), Interval=Slider(1, range=1..1000))  # -> Counter; inputs Run: Boolean
# ---------- python_3: Python ----------
import Grasshopper as gh

def updateComponent(interval):
    
    """ Update this component similar to using a grasshopper timer """
    
    def callBack(e):
        ghenv.Component.ExpireSolution(False)
        
    ghenv.Component.OnPingDocument().ScheduleSolution(interval,
    gh.Kernel.GH_Document.GH_ScheduleDelegate(callBack))

# Instantiate or reset persistent counter variable
if "count" not in globals() or not Run:
    count = -1

# Update the variable and component
if Run:
    if count < Target:
        count +=1
        updateComponent(Interval)
    elif count == Target:
        count = 24

# Output counter
Counter = count
# ---------- end python_3 ----------

# ----
# environment
panel_4 = Panel("https://climate.onebuilding.org/WMO_Region_4_North_and_Central_America/USA_United_States_of_America/CA_California/USA_CA_San.Francisco-Presidio.994016_TMYx.zip")
downloadepw = LBDownloadWeather(weather_URL=panel_4)  # -> epw_file, stat_file, ddy_file; plug-in component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
importloc = LBImportLocation(epw_file=downloadepw.epw_file)  # -> location; plug-in component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
analysisperiod = LBAnalysisPeriod(
    start_month="6",
    start_day="13",
    start_hour=python_3,
    end_month="6",
    end_day="13",
    end_hour=python_3,
    timestep=number_slider_3)  # -> period, hoys, dates; plug-in component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
sunpath = LBSunPath(location=importloc, hoys=analysisperiod.hoys, scale=1)  # -> report, vectors, altitudes, azimuths, hoys, sun_pts, analemma, daily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; plug-in component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
pt_2 = Point(Point(20.653824, -22.07013076, 0))
multiplication = Multiplication(A=sunpath.vectors, B=Slider(100, range=0..100))
vdis = VectorDisplay(Anchor=pt_2, Vector=multiplication)

panel_5 = Panel(analysisperiod.period)
panel_6 = Panel(sunpath.sun_pts)
panel_7 = Panel(sunpath.azimuths)
panel_8 = Panel(sunpath.hoys)
pt_3 = Point(panel_6)
move_2 = Move(Geometry=pt_3, Motion=pt_3)  # -> Geometry, Transform
ln = Line(StartPoint=pt, EndPoint=move_2.Geometry)
directsunhours = LBDirectSunHours(
    vectors=flatten(sunpath.vectors),
    timestep=number_slider_3,
    geometry=flatten(item_3),
    context=flatten(shading_component),
    grid_size="1",
    offset_dist="0.01",
    run=Toggle(True))  # -> report, points, results, mesh, legend, title, int_mtx; plug-in component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
sph = Sphere(Base=move_2.Geometry, Radius=Slider(5, range=0..10))
lng = ListLength(List=directsunhours.results)
larger = LargerThan(FirstNumber=flatten(directsunhours.results), SecondNumber="0")  # -> LargerThan, OrEqualTo
mjoin = MeshJoin(Meshes=directsunhours.mesh)
panel_9 = Panel(lng)
panel_10 = Panel(directsunhours.results)
cullf = CullFaces(Mesh=mjoin, Pattern=larger.LargerThan)
area_4 = Area(Geometry=flatten(mjoin))  # -> Area, Centroid
area_5 = Area(Geometry=flatten(cullf))  # -> Area, Centroid
panel_11 = Panel(larger.LargerThan)

# ----
# shadow area
panel_12 = Panel(area_5.Area)

# ----
# total area
panel_13 = Panel(area_4.Area)

merge = Merge(Data1="1-1", Data2=python_3, Data3=panel_13, Data4=panel_12)
long = LongestList(ListA=merge, ListB=python_3, PaddingMode=1)  # -> ListA, ListB
graftbydata = GraftByData(InputData=long.ListA, PathsToAssign=long.ListB)
rec = DataRecorder(graftbydata, DataLimit=-10, RecordData=True)
panel_14 = Panel(rec)

panel_15 = Panel("C:\UCBcourses\RESEARCH\Lau grant\solar\validation\grasshopper_validation_tmp")
join_2 = TextJoin(Text=[panel_15, "1-1", ".xls"])
panel_16 = Panel("""test_case
building_id
surface
hour
total_area
shaded_area""")

python_4 = GhPythonScript(x=panel_14)  # -> out, a
# ---------- python_4: Python ----------
__author__ = "vapeu"
__version__ = "2024.08.06"

import rhinoscriptsyntax as rs
def replace_null_with_zero(data):
    """
    Replace all null (None) items in the input list with 0.
    """
    if isinstance(data, list):
        return ['shaded' if item is None else item for item in data]
    else:
        return 'shaded' if data is None else data

# Get input data
data = x  # Replace 'x' with your input variable name

# Replace null items with zero
a = replace_null_with_zero(data)
# ---------- end python_4 ----------
panel_17 = Panel("Sheet1")
panel_18 = Panel(join_2)
panel_19 = Panel(python_4.a)
xl_out = WriteToExcelClassic(WorkbookFilepath=panel_18, Data=python_4.a, LocationAddress="A1", Clear=0, Stream=Button())
panel_20 = Panel(xl_out)
